# Grasshopper definition agent_panelization.gh (Grasshopper 1.0.8)

U = Slider(50, range=0..50)
V = Slider(50, range=0..50)
python_3_script = Python3Script(
    U=U,
    V=V,
    amp=Slider(5, range=0..50),
    freq=Slider(3, range=0..5),
    phase=Slider(1, range=0..1),
    size=Slider(30, range=0..100))  # -> OUT_surface, OUT_pts, OUT_uv, OUT_u_curves, OUT_v_curves, OUT_curvature, OUT_slope, OUT_slope_vec; inputs U: Int32, V: Int32, amp: Double, freq: Double, phase: Double, size: Int32
# ---------- python_3_script: Python ----------
import Rhino.Geometry as rg
import math

# ============================================================
# 1. UNIFORM SURFACE SAMPLING
# ------------------------------------------------------------
# Creating a structured UV grid over the surface provides a discrete
# representation of the parametric domain, which allows uniform evaluation
# of geometric properties such as curvature and slope. Each point on the grid
# corresponds to a specific (u, v) coordinate in parameter space.
# The grid is uniform to ensure consistent spacing, which is critical when
# later interpolating properties or generating curves. Normals are initialized
# along the Z-axis, representing an initial flat surface before deformation.
# ============================================================

def sample_surface_uniform(U, V, size):
    uv_grid = []       # Stores normalized UV coordinates in [0,1]
    pt_grid = []       # Stores the corresponding 3D coordinates in XY plane
    normal_grid = []   # Stores surface normals; initially vertical vectors

    for i in range(U):
        row_uv, row_pt, row_n = [], [], []
        u = float(i) / float(U - 1) if U > 1 else 0.0
        for j in range(V):
            v = float(j) / float(V - 1) if V > 1 else 0.0
            row_uv.append(rg.Point2d(u, v))
            row_pt.append(rg.Point3d(u * size, v * size, 0))
            # Normals point upward; they will serve as directions for later
            # displacement based on heightmap, ensuring proper orientation
            row_n.append(rg.Vector3d(0, 0, 1))
        uv_grid.append(row_uv)
        pt_grid.append(row_pt)
        normal_grid.append(row_n)

    return pt_grid, uv_grid, normal_grid

# ============================================================
# 2. HEIGHTMAP DEFINITION
# ------------------------------------------------------------
# The height at each grid point is defined by a combination of sine and cosine
# functions. This creates smooth periodic variation across the surface. Using
# the indices of the UV grid ensures reproducibility across simulations and
# allows precise control over frequency, amplitude, and phase of the pattern.
# This method provides a continuous, differentiable height field that can be
# used to compute slopes and curvature analytically. 
# ============================================================

def generate_heightmap(u_idx, v_idx, U, V, phase, amp, freq):
    return (
        amp *
        math.sin(freq * math.pi * u_idx / max(1, U - 1) + phase) *
        math.cos(freq * math.pi * v_idx / max(1, V - 1) + phase)
    )

# ============================================================
# 3. APPLY HEIGHTMAP DEFORMATION
# ------------------------------------------------------------
# Each point is displaced along its normal vector according to the heightmap.
# This approach ensures that the surface deformation respects the local orientation,
# producing smooth, continuous geometry. After deformation, the grid is translated
# so that its minimum bounding point aligns with the origin. This translation simplifies
# later calculations, keeps numerical stability, and allows comparison between surfaces.
# ============================================================

def manipulate_point_grid(pt_grid, normal_grid, U, V, phase, amp, freq):
    new_pts = []

    for i in range(U):
        row = []
        for j in range(V):
            h = generate_heightmap(i, j, U, V, phase, amp, freq)
            row.append(pt_grid[i][j] + normal_grid[i][j] * h)
        new_pts.append(row)

    # Compute translation vector so that the surface minimum corner is at the origin
    min_x = min(pt.X for row in new_pts for pt in row)
    min_y = min(pt.Y for row in new_pts for pt in row)
    min_z = min(pt.Z for row in new_pts for pt in row)
    translation = rg.Vector3d(-min_x, -min_y, -min_z)

    for i in range(U):
        for j in range(V):
            new_pts[i][j] += translation

    return new_pts

# ============================================================
# 4. NURBS SURFACE CONSTRUCTION
# ------------------------------------------------------------
# Construct a smooth, parametric NURBS surface from the deformed point grid.
# NURBS surfaces allow precise evaluation of differential geometry properties,
# like curvature and tangent vectors, which are essential for subsequent analysis.
# The surface is reparameterized to the [0,1]x[0,1] domain to maintain consistency
# for UV sampling, independent of the original size or resolution.
# ============================================================

def build_surface_from_grid(grid):
    U = len(grid)
    V = len(grid[0])
    pts = [grid[i][j] for i in range(U) for j in range(V)]

    u_deg = min(3, U - 1)
    v_deg = min(3, V - 1)

    surface = rg.NurbsSurface.CreateFromPoints(pts, U, V, u_deg, v_deg)
    if surface is None:
        raise Exception("Surface creation failed. Ensure U and V >= 2.")

    surface.SetDomain(0, rg.Interval(0.0, 1.0))
    surface.SetDomain(1, rg.Interval(0.0, 1.0))

    return surface

# ============================================================
# 5. GRID CURVE EXTRACTION
# ------------------------------------------------------------
# Curves along U and V directions provide explicit representation of the surface
# structure, facilitating visualization, measurement, or parametric manipulation.
# Interpolated curves capture the smooth variation of the surface, maintaining
# fidelity to the deformed points while allowing efficient geometric operations.
# ============================================================

def build_grid_curves(grid):
    U = len(grid)
    V = len(grid[0])

    u_curves = []
    v_curves = []

    for i in range(U):
        pts = [grid[i][j] for j in range(V)]
        if len(pts) >= 2:
            u_curves.append(rg.Curve.CreateInterpolatedCurve(pts, 3))

    for j in range(V):
        pts = [grid[i][j] for i in range(U)]
        if len(pts) >= 2:
            v_curves.append(rg.Curve.CreateInterpolatedCurve(pts, 3))

    return u_curves, v_curves

# ============================================================
# 6. GAUSSIAN CURVATURE ANALYSIS
# ------------------------------------------------------------
# Gaussian curvature is a measure of intrinsic surface bending at each point.
# By computing curvature over the UV grid and normalizing to [0,1], the code
# produces a consistent metric that can be used to guide agent-based simulations
# or other morphogenetic operations. This step is crucial for understanding
# areas of high convexity or concavity, which influence both structural behavior
# and agent movement.
# ============================================================

def compute_curvature(surface, uv_grid):
    curvature = []
    min_k = 1e9
    max_k = -1e9

    for row in uv_grid:
        row_vals = []
        for uv in row:
            try:
                curv = surface.CurvatureAt(uv.X, uv.Y)
                k = curv.Gaussian if curv else 0.0
            except:
                k = 0.0
            row_vals.append(k)
            min_k = min(min_k, k)
            max_k = max(max_k, k)
        curvature.append(row_vals)

    rng = max_k - min_k
    if rng <= 1e-12:
        # Flat or near-flat surface fallback
        return [[0.5 for _ in row] for row in curvature]

    # Normalize curvature for comparability
    for i in range(len(curvature)):
        for j in range(len(curvature[i])):
            curvature[i][j] = (curvature[i][j] - min_k) / rng

    return curvature

# ============================================================
# 7. SLOPE FIELD COMPUTATION
# ------------------------------------------------------------
# Computes the magnitude and direction of slope at each UV point.
# The slope is calculated by projecting gravity onto the tangent plane of the surface.
# Tangential vectors represent the direction in which an agent would move downhill,
# while the magnitude indicates steepness. Normalization ensures that slopes
# are comparable across the surface, regardless of absolute height variations.
# This information is essential for simulating natural flow processes, erosion,
# or agent-based exploration, and for linking curvature and slope to emergent patterns.
# ============================================================

def compute_slope(surface, uv_grid):
    slope_mag = []
    slope_vec = []
    max_mag = 0.0

    gravity = rg.Vector3d(0, 0, -1)
    zhat = rg.Vector3d(0, 0, 1)

    for row in uv_grid:
        row_mag = []
        row_vec = []
        for uv in row:
            try:
                pt, du, dv = surface.Evaluate(uv.X, uv.Y, 1)
                n = rg.Vector3d.CrossProduct(du, dv)
                if n.IsZero:
                    row_mag.append(0.0)
                    row_vec.append(rg.Vector3d(0, 0, 0))
                    continue
                n.Unitize()
                g_t = gravity - n * rg.Vector3d.Multiply(gravity, n)
                if g_t.IsZero:
                    row_mag.append(0.0)
                    row_vec.append(rg.Vector3d(0, 0, 0))
                    continue
                g_t.Unitize()
                theta = math.acos(max(-1.0, min(1.0, rg.Vector3d.Multiply(n, zhat))))
                mag = math.sin(theta)
                row_mag.append(mag)
                row_vec.append(g_t)
                max_mag = max(max_mag, mag)
            except:
                row_mag.append(0.0)
                row_vec.append(rg.Vector3d(0, 0, 0))
        slope_mag.append(row_mag)
        slope_vec.append(row_vec)

    if max_mag > 1e-12:
        for i in range(len(slope_mag)):
            for j in range(len(slope_mag[i])):
                slope_mag[i][j] /= max_mag

    return slope_mag, slope_vec

# ============================================================
# MAIN EXECUTION
# ------------------------------------------------------------
# The workflow implements a structured digital morphogenesis pipeline:
# 1. Generate a uniform UV grid to discretize the surface.
# 2. Compute a continuous heightmap using periodic functions for smooth surface variations.
# 3. Displace the planar grid along normals to create a 3D surface.
# 4. Build a NURBS surface for analytical and geometric operations.
# 5. Extract U and V grid curves for visualization or further processing.
# 6. Compute Gaussian curvature to capture intrinsic bending.
# 7. Compute slope magnitude and direction for flow or agent simulation.
# This sequence ensures that geometric, physical, and parametric properties
# are all linked and consistent across the surface domain.
# ============================================================

pt_grid, uv_grid, normal_grid = sample_surface_uniform(U, V, size)
deformed_pts = manipulate_point_grid(pt_grid, normal_grid, U, V, phase, amp, freq)
surface = build_surface_from_grid(deformed_pts)
u_curves, v_curves = build_grid_curves(deformed_pts)
curvature = compute_curvature(surface, uv_grid)
slope_mag, slope_vec = compute_slope(surface, uv_grid)

# ============================================================
# OUTPUTS
# ------------------------------------------------------------
# Provides the constructed surface, point grid, UV grid, curves, and
# analytical fields (curvature, slope magnitude, slope vectors) for
# downstream processes such as agent simulations, fabrication studies,
# or morphogenetic analysis.
# ============================================================

OUT_surface = surface
OUT_pts = deformed_pts
OUT_uv = uv_grid
OUT_u_curves = u_curves
OUT_v_curves = v_curves
OUT_curvature = curvature
OUT_slope = slope_mag
OUT_slope_vec = slope_vec
# ---------- end python_3_script ----------
surface = Surface(python_3_script.OUT_surface)
boids_builder = Python3Script(
    N=Slider(100, range=0..200),
    S=python_3_script.OUT_surface,
    uv_grid=python_3_script.OUT_uv,
    curvature=python_3_script.OUT_curvature,
    slope_mag=python_3_script.OUT_slope,
    slope_vec=python_3_script.OUT_slope_vec,
    reset=Button())  # -> out, OUT_agents, Out_position; inputs N: Int32, S: Surface, uv_grid: list, curvature: list, slope_mag: list, slope_vec: list, reset: Boolean
# ---------- boids_builder: Python ----------
import Grasshopper
import random
import rhinoscriptsyntax as rs
import Rhino
import Rhino.Geometry as rg

# ============================================================
# GEOAGENT CLASS
# ============================================================

class GeoAgent(object):

    def __init__(self, u, v, surface, dom_u, dom_v, uv_grid, curvature_field, slope_mag, slope_vec):
        self.u = u
        self.v = v
        self.surface = surface
        self.dom_u = dom_u
        self.dom_v = dom_v
        self.uv_grid = uv_grid
        self.curvature_field = curvature_field
        self.slope_mag = slope_mag
        self.slope_vec = slope_vec
        pt = rs.EvaluateSurface(surface, u, v)
        self.position = (pt.X, pt.Y, pt.Z)
        self.velocity = [random.uniform(-0.01, 0.01), random.uniform(-0.01, 0.01)]

    # ============================================================
    # FIELD SAMPLING
    # ============================================================

    def _sample_indices(self):
        u_idx = int(self.u * (len(self.uv_grid[0]) - 1))
        v_idx = int(self.v * (len(self.uv_grid) - 1))
        return u_idx, v_idx

    def _curvature_force(self):
        u_idx, v_idx = self._sample_indices()
        c = self.curvature_field[v_idx][u_idx]
        speed_scale = 1.0 - c
        return [0.0, 0.0], speed_scale

    def _slope_force(self):
        u_idx, v_idx = self._sample_indices()
        mag = self.slope_mag[v_idx][u_idx]
        vec = self.slope_vec[v_idx][u_idx]
        return [vec.X * mag, vec.Y * mag]

    # ============================================================
    # BOID-STYLE NEIGHBOR FORCES
    # ============================================================

    def _dist_uv(self, other):
        return ((self.u - other.u)**2 + (self.v - other.v)**2) ** 0.5

    def _neighbors_in_radius(self, others, radius):
        neighbors = []
        for other in others:
            if other is self:
                continue
            if self._dist_uv(other) < radius:
                neighbors.append(other)
        return neighbors

    def _separation_force(self, neighbors, separation_radius=0.05):
        steer = [0.0, 0.0]
        if not neighbors:
            return steer
        for other in neighbors:
            vec = [self.u - other.u, self.v - other.v]
            d = (vec[0]**2 + vec[1]**2) ** 0.5
            if d == 0:
                vec = [random.uniform(-1,1), random.uniform(-1,1)]
                d = (vec[0]**2 + vec[1]**2) ** 0.5
            inv_t = 1 - min(d / separation_radius, 1)
            vec = [vec[0]/d * inv_t, vec[1]/d * inv_t]
            steer[0] += vec[0]
            steer[1] += vec[1]
        return steer

    def _cohesion_force(self, neighbors):
        if not neighbors:
            return [0.0, 0.0]
        center_u = sum([o.u for o in neighbors]) / len(neighbors)
        center_v = sum([o.v for o in neighbors]) / len(neighbors)
        vec = [center_u - self.u, center_v - self.v]
        length = (vec[0]**2 + vec[1]**2) ** 0.5
        if length == 0:
            return [0.0, 0.0]
        return [vec[0]/length, vec[1]/length]

    def _alignment_force(self, neighbors):
        if not neighbors:
            return [0.0, 0.0]
        avg_vel_u = sum([o.velocity[0] for o in neighbors]) / len(neighbors)
        avg_vel_v = sum([o.velocity[1] for o in neighbors]) / len(neighbors)
        length = (avg_vel_u**2 + avg_vel_v**2) ** 0.5
        if length == 0:
            return [0.0, 0.0]
        return [avg_vel_u/length, avg_vel_v/length]

    # ============================================================
    # STEERING
    # ============================================================

    def steer(self, agents=None, radius=0.05, curv_w=1.0, slope_w=1.0,
              separation_w=100000.0, cohesion_w=0.00001, alignment_w=1.0, max_speed=0.003):
        # --- sample fields
        curv_force, speed_scale = self._curvature_force()
        slope_force = self._slope_force()

        # --- UV-space forces
        self.velocity[0] += curv_w*curv_force[0] + slope_w*slope_force[0]
        self.velocity[1] += curv_w*curv_force[1] + slope_w*slope_force[1]
        self.velocity[0] *= speed_scale
        self.velocity[1] *= speed_scale

        # --- boid forces
        if agents:
            neighbors = self._neighbors_in_radius(agents, radius)
            sep = self._separation_force(neighbors)
            coh = self._cohesion_force(neighbors)
            ali = self._alignment_force(neighbors)
            self.velocity[0] += separation_w*sep[0] + cohesion_w*coh[0] + alignment_w*ali[0]
            self.velocity[1] += separation_w*sep[1] + cohesion_w*coh[1] + alignment_w*ali[1]

        # --- clamp velocity
        speed = (self.velocity[0]**2 + self.velocity[1]**2)**0.5
        if speed > max_speed:
            self.velocity[0] = self.velocity[0]/speed*max_speed
            self.velocity[1] = self.velocity[1]/speed*max_speed

    # ============================================================
    # UPDATE POSITION
    # ============================================================

    def update(self):
        self.u += self.velocity[0]
        self.v += self.velocity[1]
        self.u = max(self.dom_u[0], min(self.dom_u[1], self.u))
        self.v = max(self.dom_v[0], min(self.dom_v[1], self.v))
        pt = rs.EvaluateSurface(self.surface, self.u, self.v)
        self.position = (pt.X, pt.Y, pt.Z)


# ============================================================
# AGENT SPAWNER
# ============================================================

def build_agents_on_surface(n, surface, uv_grid, curvature_field, slope_mag, slope_vec, seed=None):
    if seed is not None:
        random.seed(seed)
    dom_u = rs.SurfaceDomain(surface, 0)
    dom_v = rs.SurfaceDomain(surface, 1)
    agents = []
    for _ in range(n):
        u = random.uniform(dom_u[0], dom_u[1])
        v = random.uniform(dom_v[0], dom_v[1])
        agents.append(GeoAgent(u, v, surface, dom_u, dom_v, uv_grid, curvature_field, slope_mag, slope_vec))
    return agents

# ============================================================
# GRASSHOPPER COMPONENT
# ============================================================

class MyComponent(Grasshopper.Kernel.GH_ScriptInstance):
    def RunScript(self,
            N: int,
            S: Rhino.Geometry.Surface,
            uv_grid: list[object],
            curvature: list[object],
            slope_mag: list[object],
            slope_vec: list[object],
            reset: bool):
        if reset or not hasattr(self, "agents"):
            self.agents = build_agents_on_surface(N, S, uv_grid, curvature, slope_mag, slope_vec)

        # update each agent
        for a in self.agents:
            a.steer(self.agents)
            a.update()

        OUT_agents = self.agents
        OUT_positions = [rg.Point3d(a.position[0], a.position[1], a.position[2]) for a in self.agents]
        return OUT_agents, OUT_positions
# ---------- end boids_builder ----------
trigger = Trigger(Interval=50, TimerInterval=50, Target=boids_simulator)  # disabled
boids_simulator = Python3Script(
    agents=boids_builder.OUT_agents,
    S=python_3_script.OUT_surface,
    curv_w=Slider(0.6, range=0..1),
    slope_w=Slider(0.6, range=0..1),
    max_speed=Slider(0.01, range=0..1),
    sep=Slider(1, range=0..1),
    coh=Slider(0.01, range=0..1),
    ali=Slider(1, range=0..1),
    rad=Slider(0.5, range=0..10),
    max_vel=Slider(0.2, range=0..1))  # -> out, OUT_positions, OUT_vectors; inputs agents: list, curv_w: Double, slope_w: Double, max_speed: Double
# ---------- boids_simulator: Python ----------
import Rhino.Geometry as rg

# ============================================================
# AGENT EVOLUTION LOOP WITH FULL CONTROL
# ------------------------------------------------------------
# Agents are created once using build_agents_on_surface(...)
# Then this loop is run each timestep to evolve them.
# Sliders control curvature, slope, and boid-style forces.
# ============================================================

# Example initialization (outside loop):
# agents = build_agents_on_surface(N, S, uv_grid, curvature, slope_mag, slope_vec)

for a in agents:
    a.steer(
        agents=agents,       # pass full agent list
        radius=rad,          # neighbor radius
        curv_w=curv_w,       # curvature weight
        slope_w=slope_w,     # slope weight
        separation_w=sep,    # separation weight
        cohesion_w=coh,      # cohesion weight
        alignment_w=ali,     # alignment weight
        max_speed=max_speed  # clamp velocity
    )
    a.update()

# ============================================================
# GRASSHOPPER OUTPUTS
# ------------------------------------------------------------
OUT_positions = [
    rg.Point3d(a.position[0], a.position[1], a.position[2])
    for a in agents
]

OUT_vectors = [
    rg.Line(
        rg.Point3d(*a.position),
        rg.Point3d(
            a.position[0] + a.velocity[0],
            a.position[1] + a.velocity[1],
            a.position[2]
        )
    )
    for a in agents
]
# ---------- end boids_simulator ----------
vdis = VectorDisplay(Vector=boids_simulator.OUT_vectors)
con = DelaunayEdges(Points=boids_simulator.OUT_positions, Plane=PlaneXY(0, 0, 0))  # -> Connectivity, Edges
